# Dynamo custom node ReadPythonFile.dyf (Dynamo 3.0.3.7597)
# category: Revit.Ian
# Simplifies three nodes into one node

path = Input(path: string = "")
python_script = Python(IN[0]=path)  # CPython3; graph output
# ---------- python_script.python (24 lines) ----------
import clr

import Autodesk
import RevitServices
from Autodesk.Revit.DB import *

clr.AddReference('System')

clr.AddReference("RevitAPI")
clr.AddReference("RevitServices")

file_path = IN[0]
if file_path[0] == '"':
    file_path = file_path[1:]
if file_path[-1] == '"':
    file_path = file_path[0:-1]

contents = ""
with open(file_path, 'r') as file:
    contents = file.read()
      
OUT = contents

         
# ----------------------------------------
