# Dynamo custom node ScriptBundler.dyf (Dynamo 3.0.3.7597)
# category: Revit.Ian
# Bundles a bunch of string into a single list

script_0 = Input(script_0: string = "")
script_1 = Input(script_1: string = "")
script_2 = Input(script_2: string = "")
script_3 = Input(script_3: string = "")
python_script = Python(IN[0]=script_0, IN[1]=script_1, IN[2]=script_2, IN[3]=script_3)  # CPython3
# ---------- python_script.python (13 lines) ----------
script_0 = IN[0]
script_1 = IN[1]
script_2 = IN[2]
script_3 = IN[3]

pre_list = [script_0, script_1, script_2, script_3]
new_list = []

for script in pre_list:
    if script: 
        new_list.append(script)

OUT = new_list
# ----------------------------------------
