# Dynamo graph User.dyn (Dynamo 3.3.0.6316)

main_python_script = Filename("..\User - Workplane Setter.py")  # graph input
file_from_path = FileObject(path=main_python_script)
readText = FileSystem.ReadText(file=file_from_path)
string = StringInput("\"C:\\Users\\Public\\Documents\\PRIME-IAN\\Script\\lib\\Unit Matrix.py\"")
readPythonFile = Custom[ReadPythonFile](path=string)  # Simplifies three nodes into one node
string_2 = StringInput("\"C:\\Users\\Public\\Documents\\PRIME-IAN\\Script\\lib\\Functions.py\"")
readPythonFile_2 = Custom[ReadPythonFile](path=string_2)
scriptBundler = Custom[ScriptBundler](script_0=readPythonFile, script_1=readPythonFile_2)  # Bundles a bunch of string into a single list
select_model_elements = DSModelElementsSelection()  # 2 picked in the model; graph input
activate = BoolSelector(true)
script = PythonStringNode(script=readText, IN[0]=scriptBundler, IN[1]=select_model_elements, IN[2]=activate)  # CPython3
watch = Watch(script)  # graph output
